# Grasshopper definition Sphere_with_random_pattern.gh (Grasshopper 1.0.7)

# ---- group: Dimensão em metros
number_slider = Slider(50, range=0..50)
number_slider_2 = Slider(30, range=0..50)

# ----
xy = XYPlane(Origin=Point(0, 0, 0))
radius = Slider(50, range=0..50)
subtraction = Subtraction(A=number_slider, B=number_slider_2)
# Ref.: https://www.youtube.com/watch?v=NWVq7SAe2zI&list=LL&index=129
xy_2 = XYPlane(Origin=Point(0, 0, 0))
sph = Sphere(Base=xy, Radius=number_slider)
Z = UnitZ(Factor=subtraction)
subtraction_2 = Subtraction(A=radius, B=Slider(30, range=0..50))
cir = Circle(Plane=PlaneXY(0, 0, 0), Radius=Slider(100, range=0..100))
Z_2 = UnitZ(Factor=subtraction_2)
move = Move(Geometry=sph, Motion=Z)  # -> Geometry, Transform
scale = Scale(Geometry=move.Geometry, Center=Point(0, 0, 0), Factor=Slider(0.95, range=0..10))  # -> Geometry, Transform
python = GhPythonScript(plane=xy_2, radius=radius, translation=Z_2)  # -> out, object, a, circle; inputs translation: Vector3d
# ---------- python: Python ----------
__author__ = "Renato"
__version__ = "2021.01.23"

import rhinoscriptsyntax as rs

sphere = rs.AddSphere(plane, radius)

a = rs.MoveObject(sphere, translation)

#cortar base

circle = rs.AddCircle(plane, 100)

#cortar = rs.SplitBrep(a, circle, delete_input=False)
# ---------- end python ----------
split = SplitBrep(Brep=move.Geometry, Cutter=cir)
split_2 = SplitBrep(Brep=scale.Geometry, Cutter=cir)
item = ListItem(List=split, Index=0, Wrap=True)
panel = Panel(split)
item_2 = ListItem(List=split_2, Index=0, Wrap=True)
panel_2 = Panel(split_2)
srf = Surface(item)
srf_2 = Surface(item_2)
preview = CustomPreview(Geometry=srf_2, Material=ColourSwatch(SwatchColor=RGBA(255, 255, 255, 108)))
number_slider_3 = Slider(160, range=0..1000)
random = Random(Range=Slider(500, range=0..1000), Number=Slider(3, range=0..10), Seed=2)
srf_3 = Surface(item)
popgeo = PopulateGeometry(Geometry=srf_3, Count=number_slider_3, Seed=1)
rad = Radians(Degrees=Slider(200, range=0..200))
srf_cp = SurfaceClosestPoint(Point=popgeo, Surface=srf_3)  # -> Point, UVPoint, Distance
random_2 = Random(Range=Domain(0, 1), Number=number_slider_3, Seed=random)  # -> simplify(Random)
random_3 = Random(Range=rad, Number=number_slider_3, Seed=2)
evalsrf = EvaluateSurface(Surface=srf_3, Point=srf_cp.UVPoint)  # -> Point, Normal, UDirection, VDirection, Frame
python_2 = GhPythonScript()  # -> out, a; unedited script template
bang = ExplodeTree(Data=random_2)  # -> Branch0, Branch1, Branch2
vec = VectorXYZ(XComponent=bang.Branch0, YComponent=bang.Branch1, ZComponent=bang.Branch2)  # -> Vector, Length
rot3d = Rotate3D(Geometry=evalsrf.Frame, Angle=random_3, Center=evalsrf.Frame, Axis=vec.Vector)  # -> Geometry, Transform
edges = BrepEdges(Brep=srf_3)  # -> Naked, Interior, NonManifold
sec = BrepPlane(Brep=srf_3, Plane=rot3d.Geometry)  # -> Curves, Points
crv = Curve(edges.Naked)

# ---- group: Dimensão em metros
number_slider_4 = Slider(50, range=0..50)  # disabled
number_slider_5 = Slider(30, range=0..50)  # disabled

# ----
number_slider_6 = Slider(100, range=0..100)  # disabled
xy_3 = XYPlane(Origin=Point(0, 0, 0))  # disabled
subtraction_3 = Subtraction(A=number_slider_4, B=number_slider_5)  # disabled
number_slider_7 = Slider(10, range=0..10)  # disabled
sph_2 = Sphere(Base=xy_3, Radius=number_slider_4)  # disabled
number_slider_8 = Slider(70, range=0..100)  # disabled
number_slider_9 = Slider(40, range=0..100)  # disabled
Z_3 = UnitZ(Factor=subtraction_3)  # disabled
cir_2 = Circle(Plane=PlaneXY(0, 0, 0), Radius=number_slider_6)  # disabled
move_2 = Move(Geometry=sph_2, Motion=Z_3)  # -> Geometry, Transform; disabled
neg = Negative(Value=number_slider_8)  # disabled
addition = Addition(A=number_slider_6, B=number_slider_7)  # disabled
split_3 = SplitBrep(Brep=move_2.Geometry, Cutter=cir_2)  # disabled
number_slider_10 = Slider(200, range=0..200)  # disabled
pt = ConstructPoint(XCoordinate=addition, YCoordinate=0, ZCoordinate=0)  # disabled
pt_2 = ConstructPoint(XCoordinate=neg, YCoordinate=0, ZCoordinate=number_slider_9)  # disabled
item_3 = ListItem(List=split_3, Index=0, Wrap=True)  # disabled
panel_3 = Panel(split_3)  # disabled
number_slider_11 = Slider(0, range=0..100)  # disabled
number_slider_12 = Slider(0.94, range=0..5)  # disabled
line = LineSDL(Start=pt, Direction=pt_2, Length=number_slider_10)  # disabled
srf_4 = Surface(item_3)  # disabled
scx = SurfaceCurve(Surface=srf_4, Curve=line)  # -> Curves, Points, UVPoints, Normals, Parameters, Tangents; disabled
pt_3 = ConstructPoint(XCoordinate=number_slider_11, YCoordinate=number_slider_12, ZCoordinate=0)  # disabled
panel_4 = Panel(scx.Tangents)  # disabled
evalsrf_2 = EvaluateSurface(Surface=reparameterize(srf_4), Point=pt_3)  # -> Point, Normal, UDirection, VDirection, Frame; disabled
number_slider_13 = Slider(20, range=0..20)  # disabled
evalsrf_3 = EvaluateSurface(Surface=reparameterize(srf_4), Point=scx.UVPoints)  # -> Point, Normal, UDirection, VDirection, Frame; disabled
panel_5 = Panel(evalsrf_2.Normal)  # disabled
cir_3 = Circle(Plane=evalsrf_3.Frame, Radius=number_slider_13)  # disabled
project = Project(Curve=cir_3, Brep=item_3, Direction=evalsrf_2.Normal)  # -> flatten(Curve); disabled
number_slider_14 = Slider(0, range=0..1)  # disabled
number_slider_15 = Slider(100, range=0..100)  # disabled
number_slider_16 = Slider(500, range=0..1000)  # disabled
number_slider_17 = Slider(3, range=0..10)  # disabled
srfsplit = SurfaceSplit(Surface=srf_4, Curves=project)  # disabled
item_4 = ListItem(List=srfsplit, Index=number_slider_14, Wrap=True)  # disabled
rad_2 = Radians(Degrees=number_slider_15)  # disabled
number_slider_18 = Slider(160, range=0..1000)  # disabled
random_4 = Random(Range=number_slider_16, Number=number_slider_17, Seed=2)  # disabled
random_5 = Random(Range=Domain(0, 1), Number=number_slider_18, Seed=random_4)  # -> simplify(Random); disabled
random_6 = Random(Range=rad_2, Number=number_slider_18, Seed=2)  # disabled
srf_5 = Surface(item_4)  # disabled
popgeo_2 = PopulateGeometry(Geometry=srf_5, Count=number_slider_18, Seed=1)  # disabled
srf_cp_2 = SurfaceClosestPoint(Point=popgeo_2, Surface=srf_5)  # -> Point, UVPoint, Distance; disabled
evalsrf_4 = EvaluateSurface(Surface=srf_5, Point=srf_cp_2.UVPoint)  # -> Point, Normal, UDirection, VDirection, Frame; disabled
bang_2 = ExplodeTree(Data=random_5)  # -> Branch0, Branch1, Branch2; disabled
vec_2 = VectorXYZ(XComponent=bang_2.Branch0, YComponent=bang_2.Branch1, ZComponent=bang_2.Branch2)  # -> Vector, Length; disabled
rot3d_2 = Rotate3D(Geometry=evalsrf_4.Frame, Angle=random_6, Center=evalsrf_4.Frame, Axis=vec_2.Vector)  # -> Geometry, Transform; disabled
edges_2 = BrepEdges(Brep=srf_5)  # -> Naked, Interior, NonManifold; disabled
number_slider_19 = Slider(0.05, range=0..0.1)  # disabled
number_slider_20 = Slider(2, range=0..10)  # disabled
number_slider_21 = Slider(0.2, range=0.02..0.5)  # disabled
sec_2 = BrepPlane(Brep=srf_5, Plane=rot3d_2.Geometry)  # -> Curves, Points; disabled
number_slider_22 = Slider(2, range=0..10)  # disabled
crv_2 = Curve(edges_2.Naked)  # disabled
pipe = Pipe(Curve=crv_2, Radius=number_slider_19, Caps=number_slider_20)  # disabled
pipe_2 = Pipe(Curve=sec_2.Curves, Radius=number_slider_21, Caps=number_slider_22)  # disabled
merge = Merge(Data1=pipe)  # disabled
